# Grasshopper definition Points_xyz_gcode.gh (Grasshopper 1.0.8)

point_coordinates = Panel("""0,0,0
50,0,0
50,50,0
0,50,0""")
point = Point(point_coordinates)
points_to_gcode = PointsToGCODE(A="30", B="60", point=point)
panel = Panel(points_to_gcode)

# ==== cluster PointsToGCODE
point = ClusterInput()
point_2 = Point(point)
list_item = ListItem(List=point_2, Index=0, Wrap=True)
list_length = ListLength(List=point_2)
insert_items = InsertItems(List=point_2, Item=list_item, Indices=list_length, Wrap=True)
polyline = PolyLine(Vertices=insert_items, Closed=False)
explode = Explode(Curve=polyline, Recursive=True)  # -> Segments, Vertices
# 0 mm extruded from the beginning position.
length = Length(Curve=explode.Segments)
B = ClusterInput()
A = ClusterInput()
insert_items_2 = InsertItems(List=length, Item="0", Indices="0", Wrap=True)
deconstruct = Deconstruct(Point=point_2)  # -> XComponent, YComponent, ZComponent
mass_addition = MassAddition(Input=insert_items_2)  # -> Result, PartialResults
# Feed Rate - 30mm per second
multiplication = Multiplication(A=A, B=B)
concatenate = Concatenate(
    FragmentH="G1",
    FragmentG=" F",
    FragmentK=multiplication,
    FragmentA=" X",
    FragmentB=deconstruct.XComponent,
    FragmentC=" Y",
    FragmentD=deconstruct.YComponent,
    FragmentE=" Z",
    FragmentF=deconstruct.ZComponent,
    FragmentI=" E",
    FragmentJ=mass_addition.PartialResults)
panel = Panel(concatenate)
panel_2 = Panel("""; -- START GCODE -- 
G21 
G90
M82
M107
M140 S{material_bed_temperature_layer_0}
M104 S{material_print_temperature_layer_0} T0
G28
G1 Z5.0
G1 X0 Y0
M190 S{material_bed_temperature_layer_0}
M109 S{material_print_temperature_layer_0} T0 
G92 E0 
G1 Z2.0 F3000 
G1 X16.1 Y40 Z0.2 F3600.0 
G1 Y160 F1500.0 E10 
G1 X16.4 F3600.0 
G1 Y40 F1500.0 E20 
G92 E0
G1 Z2.0 F3000 
G1 X18 Y40 Z0.2 F3600.0 
G92 E0 
; -- end of START GCODE -""")
panel_3 = Panel("""; -- END GCODE -- 
M83
G1 E-5 F3000
G91
G1 Z5
G90
G1 X0 Y{machine_depth}
M106 S0
M104 S0
M140 S0
M84
; -- end of END GCODE -""")
merge = Merge(Data1=flatten(panel_2), Data2=flatten(panel), Data3=flatten(panel_3))
result = ClusterOutput(merge)
