# Grasshopper definition Polylines_points_xyz_gcode.gh (Grasshopper 1.0.8)

panel = Panel("""0,0,0
50,0,0
50,50,0
0,50,0
0,0,10
50,0,10
50,50,10
0,50,10
0,0,20
50,0,20
50,50,20
0,50,20""")
polyline = PolyLine(Vertices=panel, Closed=Toggle(False))
discontinuity = Discontinuity(Curve=polyline, Level=1)  # -> Points, Parameters
control_polygon = ControlPolygon(Curve=polyline)  # -> Polygon, Points
control_points = ControlPoints(Curve=polyline)  # -> Points, Weights, Knots
panel_2 = Panel(control_points.Points)
panel_3 = Panel(discontinuity.Points)
panel_4 = Panel(control_polygon.Points)
explode = Explode(Curve=polyline, Recursive=True)  # -> Segments, Vertices
length = Length(Curve=explode.Segments)
integer = Integer(length)
insert_items = InsertItems(List=integer, Item="0", Indices="0", Wrap=True)
point = Point(panel_2)
panel_5 = Panel(insert_items)
mass_addition = MassAddition(Input=flatten(insert_items))  # -> Result, PartialResults
deconstruct = Deconstruct(Point=flatten(point))  # -> XComponent, YComponent, ZComponent
# Feed Rate - 30mm per second
panel_6 = Panel("30")
panel_7 = Panel(mass_addition.PartialResults)
multiplication = Multiplication(A=panel_6, B="60")
concatenate = Concatenate(
    FragmentH="G1",
    FragmentG=" F",
    FragmentK=multiplication,
    FragmentA=" X",
    FragmentB=deconstruct.XComponent,
    FragmentC=" Y",
    FragmentD=deconstruct.YComponent,
    FragmentE=" Z",
    FragmentF=deconstruct.ZComponent,
    FragmentI=" E",
    FragmentJ=panel_7)
panel_8 = Panel(concatenate)
panel_9 = Panel("""; -- START GCODE -- 
G21 
G90
M82
M107
M140 S{material_bed_temperature_layer_0}
M104 S{material_print_temperature_layer_0} T0
G28
G1 Z5.0
G1 X0 Y0
M190 S{material_bed_temperature_layer_0}
M109 S{material_print_temperature_layer_0} T0 
G92 E0 
G1 Z2.0 F3000 
G1 X16.1 Y40 Z0.2 F3600.0 
G1 Y160 F1500.0 E10 
G1 X16.4 F3600.0 
G1 Y40 F1500.0 E20 
G92 E0
G1 Z2.0 F3000 
G1 X18 Y40 Z0.2 F3600.0 
G92 E0 
; -- end of START GCODE -""")
panel_10 = Panel("""; -- END GCODE -- 
M83
G1 E-5 F3000
G91
G1 Z5
G90
G1 X0 Y{machine_depth}
M106 S0
M104 S0
M140 S0
M84
; -- end of END GCODE -""")
merge = Merge(Data1=flatten(panel_9), Data2=flatten(panel_8), Data3=flatten(panel_10))
panel_11 = Panel(merge)
