# Grasshopper definition pointsGCode.gh (Grasshopper 1.0.7)

point_coordinates = Panel("""0,0,0
50,0,0
50,50,0
0,50,0""")
list_item = ListItem(List=point_coordinates, Index=0, Wrap=True)
list_length = ListLength(List=point_coordinates)
point = Point(point_coordinates)
insert_items = InsertItems(List=point_coordinates, Item=list_item, Indices=list_length, Wrap=True)
deconstruct = Deconstruct(Point=point)  # -> XComponent, YComponent, ZComponent
polyline = PolyLine(Vertices=insert_items, Closed=False)
explode = Explode(Curve=polyline, Recursive=True)  # -> Segments, Vertices
# Feed Rate - 30mm per second
panel = Panel("30")
# mm extruded from the current position to the next
length = Length(Curve=explode.Segments)
multiplication = Multiplication(A=panel, B="60")
insert_items_2 = InsertItems(List=length, Item="0", Indices="0", Wrap=True)
mass_addition = MassAddition(Input=insert_items_2)  # -> Result, PartialResults
concatenate = Concatenate(
    FragmentH="G1",
    FragmentG=" F",
    FragmentK=multiplication,
    FragmentA=" X",
    FragmentB=deconstruct.XComponent,
    FragmentC=" Y",
    FragmentD=deconstruct.YComponent,
    FragmentE=" Z",
    FragmentF=deconstruct.ZComponent,
    FragmentI=" E",
    FragmentJ=mass_addition.PartialResults)
panel_2 = Panel(concatenate)
panel_3 = Panel("""; -- START GCODE -- 
G21 
G90
M82
M107
M140 S{material_bed_temperature_layer_0}
M104 S{material_print_temperature_layer_0} T0
G28
G1 Z5.0
G1 X0 Y0
M190 S{material_bed_temperature_layer_0}
M109 S{material_print_temperature_layer_0} T0 
G92 E0 
G1 Z2.0 F3000 
G1 X16.1 Y40 Z0.2 F3600.0 
G1 Y160 F1500.0 E10 
G1 X16.4 F3600.0 
G1 Y40 F1500.0 E20 
G92 E0
G1 Z2.0 F3000 
G1 X18 Y40 Z0.2 F3600.0 
G92 E0 
; -- end of START GCODE -""")
panel_4 = Panel("""; -- END GCODE -- 
M83
G1 E-5 F3000
G91
G1 Z5
G90
G1 X0 Y{machine_depth}
M106 S0
M104 S0
M140 S0
M84
; -- end of END GCODE -""")
merge = Merge(Data1=flatten(panel_3), Data2=flatten(panel_2), Data3=flatten(panel_4))
panel_5 = Panel(merge)
